# Dynamo graph GetSetSharedParameterValue.dyn (Dynamo 1.3.0.875)

family_types = FamilyTypes("Receptacle - Power - Surface:Plain")
select_model_element = DSModelElementSelection()  # 1 picked in the model
get_family_parameter = FamilyInstanceParameters("ID-INSTANCE(Type)(string)", select_model_element)
getParameterValueByName = Element.GetParameterValueByName(element=select_model_element, parameterName=get_family_parameter)
string_from_object = FromObject(get_family_parameter)
code_block = CodeBlock { "Test"; }
setParameterByName = Element.SetParameterByName(element=select_model_element, parameterName=string_from_object, value=code_block)
