# Dynamo graph Create HTML Table.dyn (Dynamo 1.3.0.875)

html_head = StringInput("""<!DOCTYPE html>
<html lang="en">
<head>
  <title>Web Page from Dynamo</title>
  <meta charset="utf-8">
  <meta name="viewport" content="width=device-width, initial-scale=1">
  <link rel="stylesheet" href="https://maxcdn.bootstrapcdn.com/bootstrap/3.3.7/css/bootstrap.min.css">
  <script src="https://ajax.googleapis.com/ajax/libs/jquery/3.2.0/jquery.min.js"></script>
  <script src="https://maxcdn.bootstrapcdn.com/bootstrap/3.3.7/js/bootstrap.min.js"></script>

<style>
/* Custom container */
.container-fixed {
  margin: 0 auto;
  max-width: 960px;
}
.container-fixed > hr {
  margin: 30px 0;
}
</style>

</head>
""")
html_opening_body = StringInput("""<body>
<div class="container-fixed">""")
file_path = Filename("..\DB\Sheets.db")
boolean = BoolSelector(true)
string = StringInput("SELECT \"Sheet Number\", \"Sheet Name\", \"Sheet Issue Date\" FROM Sheets;")
SQLite_Query = Database.Query.SQLite_Query(file_path, boolean, string)
html_closing_tags = StringInput("""</div>
</body>
</html>""")
table_classes = StringInput("table table-striped")
python_script = Python(IN[0]=html_head, IN[1]=html_opening_body, IN[2]=SQLite_Query, IN[3]=html_closing_tags, IN[4]=table_classes)
# ---------- python_script.python (31 lines) ----------
import clr
clr.AddReference('ProtoGeometry')
from Autodesk.DesignScript.Geometry import *
#The inputs to this node will be stored as a list in the IN variables.
htmlHead = IN[0]
htmlBodyOpen = IN[1]
listIn = IN[2]
htmlClose = IN[3]
tableClasses = IN[4]

html = ""
html += htmlHead + "\n"
html += htmlBodyOpen + "\n"

html += "<table class=\"" + tableClasses + "\"" + ">\n"
html += "<tbody>\n"
for index, i in enumerate(listIn):
	if len(listIn[index][0]) > 0:
		html += "<tr> \n"
	if len(listIn[index][0]) > 0:
		for index2, i in enumerate(listIn[index]):
			html += "\t<td>" + listIn[index][index2] + "</td> \n"
	if len(listIn[index][0]) > 0:
		html += "</tr> \n"
html += "</tbody>"
html += "</table>\n"

html += htmlClose

#Assign your output to the OUT variable.
OUT = html
# ----------------------------------------
watch = Watch(python_script)
code_block = CodeBlock { "test.html"; }
writeText = File.WriteText(code_block, python_script)
string_2 = StringInput("")
