# Dynamo graph Create Table With Parameter Names.dyn (Dynamo 1.3.0.875)

# group: Set Category
categories = Categories("DuctCurves")

# group: Get all elements and their parameters
all_elements_of_category = ElementsOfCategory(categories)
parameters = Element.Parameters(all_elements_of_category)
watch = Watch(parameters)

# group: Get parameter values
value = Parameter.Value(parameters)
watch_2 = Watch(value)
string_from_object = FromObject(watch_2)
string = StringInput("ø")
string_2 = StringInput("Diameter")
list_of_lists_of_lists_of_values = String.Replace(str=string_from_object, searchFor=string, replaceWith=string_2)
watch_3 = Watch(list_of_lists_of_lists_of_values)

# group: Get parameter names
name = Parameter.Name(parameters)
watch_4 = Watch(name)

# group: Get one element's parameters and values.
py_create_dictionary = Python(IN[0]=watch_3, IN[1]=watch_4)
# ---------- py_create_dictionary.python (15 lines) ----------
import clr
clr.AddReference('ProtoGeometry')
from Autodesk.DesignScript.Geometry import *
#The inputs to this node will be stored as a list in the IN variables.

values = IN[0]
keys = IN[1]

#myDic = [dict(zip(keys[0], values[0])) for i in keys[0]]

myDic = dict(zip(keys[0],values[0]))

#Assign your output to the OUT variable.
#OUT = myDic["Width"]
OUT = myDic.items()
# ----------------------------------------
watch_5 = Watch(py_create_dictionary)

# group: Test: Write values to Excel
code_block = CodeBlock { "temp.xlsx"; "Sheet1"; 0; 0; }
boolean = BoolSelector(false)
writeToFile = Excel.WriteToFile(filePath=code_block.out0, sheetName=code_block.out1, startRow=code_block.out2, startCol=code_block.out3, data=py_create_dictionary, overWrite=boolean)

python_string_from_object = Python(IN[0]=categories)
# ---------- python_string_from_object.python (9 lines) ----------
import clr
clr.AddReference('ProtoGeometry')
from Autodesk.DesignScript.Geometry import *
#The inputs to this node will be stored as a list in the IN variables.
category = IN[0]


#Assign your output to the OUT variable.
OUT = '"' + str(category) + '"'
# ----------------------------------------

# group: Create a list of parameter names
code_block_2 = CodeBlock { "Element Id"; }
code_block_3 = CodeBlock { 1; }
flatten = List.Flatten(list=watch_4, amt=code_block_3)
uniqueItems = List.UniqueItems(flatten)
addItemToFront = List.AddItemToFront(item=code_block_2, list=uniqueItems)
watch_6 = Watch(addItemToFront)

# group: Create table in SQLite db
python_create_string = Python(IN[0]=watch_6)
# ---------- python_create_string.python (12 lines) ----------
import clr
clr.AddReference('ProtoGeometry')
from Autodesk.DesignScript.Geometry import *
#The inputs to this node will be stored as a list in the IN variables.
list1 = IN[0]

#string = string[1:-1]

string = ', '.join('"{0}"'.format(w) for w in list1)

#Assign your output to the OUT variable.
OUT = string
# ----------------------------------------
python_script = Python(IN[0]=python_string_from_object, IN[1]=python_create_string)  # unwired: IN[2], IN[3]
# ---------- python_script.python (34 lines) ----------
import clr
clr.AddReference('ProtoGeometry')
from Autodesk.DesignScript.Geometry import *

tableName = IN[0]
stringOfFields = IN[1]
listOfFields = IN[2]
listOfValues = IN[3]


# Does this help? Create dictionary items with first value as key
# dictionary = {e[0] : e[0:] for e in listOfValues}
# dicString = ", ".join(listOfValues[0])

# Create SQL command
# TODO: Loop through listOfFields and insert as table fields
# TODO: Loop through listOfValues and insert as table values
sqlCommand = "DROP TABLE IF EXISTS " + tableName + "; \n"
sqlCommand += "CREATE TABLE " + tableName + "(" + stringOfFields + "); \n"
#sqlCommand += "CREATE TABLE " + tableName + " (ElementId INTEGER, Height REAL, Width REAL, Diameter REAL, Length REAL, CONSTRAINT ElementPk PRIMARY KEY (ElementId));\n" + "BEGIN TRANSACTION; \n"

# Add BEGIN TRANSACTION to command
#sqlCommand += "BEGIN TRANSACTION; \n"

# Insert values into table
#for item in enumerate(listOfValues):
#    sqlCommand+=str("INSERT INTO " + tableName +
#              "(ElementId, Height, Width, Diameter, Length) " +
#              "VALUES (" + "".join(str(item[1]).translate(None, "[]")) + ");\n")

#sqlCommand+="COMMIT;"

# Output for SQLite command node
OUT = sqlCommand
# ----------------------------------------
watch_7 = Watch(python_script)
file_path = Filename("..\DB\Mechanical.db")
boolean_2 = BoolSelector(true)
SQLite_Command = Database.Command.SQLite_Command(file_path, boolean_2, python_script)
end = Revit.Transaction.Transaction.End(SQLite_Command)
