# Dynamo graph Create Timestamped Table and Insert Values.dyn (Dynamo 1.3.0.875)

# group: Set Category
categories = Categories("Floors")

# group: Get all elements and their parameters
all_elements_of_category = ElementsOfCategory(categories)
parameters = Element.Parameters(all_elements_of_category)
watch = Watch(parameters)

python_timestamped_table_name = Python(IN[0]=categories)
# ---------- python_timestamped_table_name.python (17 lines) ----------
import clr
clr.AddReference('ProtoGeometry')
from Autodesk.DesignScript.Geometry import *

import sys
sys.path.append(r'C:\Program Files (x86)\IronPython 2.7\DLLs')
sys.path.append(r'C:\Program Files (x86)\IronPython 2.7\Lib')

import time

tableName = str(IN[0])
dateTimeNow = str(time.time())

fullTableName = "\"" + tableName + "_" + dateTimeNow + "\""

# Output timestamped table name
OUT = fullTableName
# ----------------------------------------

# group: Get parameter names
name = Parameter.Name(parameters)
watch_2 = Watch(name)

# group: Create a list of parameter names
code_block = CodeBlock { "Element Id"; }
code_block_2 = CodeBlock { 1; }
flatten = List.Flatten(list=watch_2, amt=code_block_2)
uniqueItems = List.UniqueItems(flatten)
addItemToFront = List.AddItemToFront(item=code_block, list=uniqueItems)
watch_3 = Watch(addItemToFront)

# group: A) Set database file
# note: Two options:
# A) Use File Path to choose database file
# B) Set database file relative to current (Revit) document
file_path = Filename("..\DB\Architectural.db")

# group: Create table in databas with current date/time as suffix
python_create_string = Python(IN[0]=watch_3)
# ---------- python_create_string.python (12 lines) ----------
import clr
clr.AddReference('ProtoGeometry')
from Autodesk.DesignScript.Geometry import *
#The inputs to this node will be stored as a list in the IN variables.
list1 = IN[0]

#string = string[1:-1]

string = ', '.join('"{0}"'.format(w) for w in list1)

#Assign your output to the OUT variable.
OUT = string
# ----------------------------------------
python_script = Python(IN[0]=python_timestamped_table_name, IN[1]=python_create_string)
# ---------- python_script.python (13 lines) ----------
import clr
clr.AddReference('ProtoGeometry')
from Autodesk.DesignScript.Geometry import *

tableName = str(IN[0])
stringOfFields = IN[1]

# Create SQL command
sqlCommand = "DROP TABLE IF EXISTS " + tableName + "; \n"
sqlCommand += "CREATE TABLE " + tableName + "(" + stringOfFields + "); \n"

# Output for SQLite command node
OUT = sqlCommand
# ----------------------------------------
watch_4 = Watch(python_script)
boolean = BoolSelector(true)
SQLite_Command = Database.Command.SQLite_Command(file_path, boolean, python_script)

# group: Wait for table to be created before writing values
passthrough = Custom[Passthrough](passThrough=all_elements_of_category, waitFor=SQLite_Command)  # Forces a sequential order of execution. The node wired into the output of the Passthrough node will be executed *after* the node wired into the waitFor input (e.g. important for some Revit operations). The value of the passThrough input will be passed on to the node wired into the output port of the Passthrough node.
parameters_2 = Element.Parameters(passthrough)

# group: Insert Element Id's to beginning of lists
id = Element.Id(passthrough)
python_script_2 = Python(IN[0]=id)
# ---------- python_script_2.python (11 lines) ----------
import clr
clr.AddReference('ProtoGeometry')
from Autodesk.DesignScript.Geometry import *
#The inputs to this node will be stored as a list in the IN variables.
listIn = IN[0]

for index, i in enumerate(listIn):
	listIn[index] = "Element Id : " + str(i)

#Assign your output to the OUT variable.
OUT = listIn
# ----------------------------------------
python_script_3 = Python(IN[0]=parameters_2, IN[1]=python_script_2)
# ---------- python_script_3.python (12 lines) ----------
import clr
clr.AddReference('ProtoGeometry')
from Autodesk.DesignScript.Geometry import *
#The inputs to this node will be stored as a list in the IN variables.
mainList = IN[0]
elementIds = IN[1]

for ele_a, ele_b in zip(mainList, elementIds):
    ele_a.insert(0, ele_b)

#Assign your output to the OUT variable.
OUT = mainList
# ----------------------------------------
watch_5 = Watch(python_script_3)

# group: Create list of Element Ids with sublists of parameters
python_create_sublists = Python(IN[2]=python_script_3)  # unwired: IN[0], IN[1]
# ---------- python_create_sublists.python (14 lines) ----------
import clr
clr.AddReference('ProtoGeometry')
from Autodesk.DesignScript.Geometry import *
#The inputs to this node will be stored as a list in the IN variables.
#The inputs to this node will be stored as a list in the IN variables.
tableName = IN[0]
listOfFields = IN[1]
listOfValues = IN[2]

# Create dictionary items with first value as key
dictionary = {e[0].split(" : ")[1] : e[1:] for e in listOfValues}

#Assign your output to the OUT variable.
OUT = dictionary.items()
# ----------------------------------------
watch_6 = Watch(python_create_sublists)

# group: Create dictionary of parameters (all elements)
python_create_dictionary = Python(IN[0]=watch_6)
# ---------- python_create_dictionary.python (55 lines) ----------
import clr
clr.AddReference('ProtoGeometry')
from Autodesk.DesignScript.Geometry import *
#The inputs to this node will be stored as a list in the IN variables.
listIn = IN[0]

oneElement = listIn[0]
oneElementId = oneElement[0]
oneElementsParams = oneElement[1]

allElements = []


for index, i in enumerate(listIn):
	allElements.append(["Element Id : " + listIn[index][0]])
	
for index, i in enumerate(listIn):
	for pIndex, p in enumerate(listIn[index][1]):
		allElements[index].append(listIn[index][1][pIndex])
		
allValues = [[] for i in listIn]
		
for index, i in enumerate(allElements):
	for pIndex, i in enumerate(allElements[index]):
		#allValues[index].append(str(allElements[index][pIndex]).split(" : ", 1)[1])
		allValues[index].append(str(allElements[index][pIndex]).split(" : "))

#myDict = dict(str(item).split(" : ") for index, item in enumerate(allElements[index]))

#for index, i in enumerate(allElements):
#	myDict.append(dict(str(item).split(" : ") for item in allElements[index]))

#Create dictionary of parameters with key from param name
#myDic = dict(str(item).split(" : ") for item in oneElementsParams)

# Add Element Id to dictionary
#myDic['Element Id'] = oneElementId

OUT = allValues

# Output dictionary with Element Id as key
#elementDict = dict(zip(listIn[0][0:][0],listIn[0][0:][1]))
#OUT = elementDict.items()

# First element
#OUT = listIn[0][0]

# Drill down to first element Id
#OUT = listIn[0][0][0]

# Drill down to first list of parameters 
#OUT = listIn[0][0][1]

# Drill down to first parameter in first list of parameters
#OUT = listIn[0][1][0]
# ----------------------------------------
watch_7 = Watch(python_create_dictionary)

# group: Create SQL command
python_sql_command = Python(IN[0]=watch_7, IN[1]=python_timestamped_table_name)
# ---------- python_sql_command.python (65 lines) ----------
import clr
clr.AddReference('ProtoGeometry')
from Autodesk.DesignScript.Geometry import *
#The inputs to this node will be stored as a list in the IN variables.
listIn = IN[0]
tableName = IN[1]

sqlCommand = "BEGIN TRANSACTION; \n"
questionMarks = ""
listOfColumns = []
columnNames = ""
columnValues = ""


for index1, i1 in enumerate(listIn):
	sqlCommand += "INSERT INTO " + tableName + " ("
	for index2, i2 in enumerate(listIn[index1]):
		sqlCommand += '"' + listIn[index1][index2][0] + '", '
	sqlCommand = sqlCommand[:-2]
	sqlCommand += ") \n VALUES ("
	for index2, i2 in enumerate(listIn[index1]):
		listIn[index1][index2][1] = listIn[index1][index2][1].replace("\"", " in")
		listIn[index1][index2][1] = listIn[index1][index2][1].replace("\'", " ft")
		listIn[index1][index2][1] = listIn[index1][index2][1].replace("ø", " Diam")
		listIn[index1][index2][1] = listIn[index1][index2][1].replace("°", " Degrees")
		sqlCommand += '"' + listIn[index1][index2][1] + '\", '
	sqlCommand = sqlCommand[:-2]
	sqlCommand += "); \n"
	
sqlCommand += "COMMIT;"
	
OUT = sqlCommand

	#sqlCommand += columnNames + "\n"
#	for pIndex, i in enumerate(listIn[listIndex]):
#		columnNames += listIn[listIndex][pIndex][0] + '"' + ', '
		
#for listIndex, i in enumerate(listIn):
#	for pIndex, i in enumerate(listIn[listIndex]):
#		for param, i in enumerate(listIn[listIndex][pIndex]):
#			listOfColumns.append('"' + listIn[listIndex][pIndex][0] + '"' + ', ')


#columnNames = columnNames[:-2]

#for listIndex, i in enumerate(listIn):
	# Catch and replace certain characters that break the string
#	listIn[listIndex][1] = listIn[listIndex][1].replace("\"", " in")
#	listIn[listIndex][1] = listIn[listIndex][1].replace("\'", " ft")
#	listIn[listIndex][1] = listIn[listIndex][1].replace("ø", " Diam")
	
	# Write to columnValues with values wrapped in quptes and separated by commas
#	columnValues += '"' + listIn[listIndex][1] + '"' + ', '
#columnValues = columnValues[:-2]

#for listIndex, i in enumerate(listIn):
#	questionMarks += '?, '
#questionMarks = questionMarks[:-2]

# Create a table in the db
#sqlCommand += "CREATE TABLE " + tableName + " (" + columnNames + ") \n"


#sqlCommand += "VALUES (" + questionMarks + "), " + columnValues
#sqlCommand += "VALUES (" + columnValues + ")"
# ----------------------------------------
watch_8 = Watch(python_sql_command)

# group: Write values to database
boolean_2 = BoolSelector(true)
SQLite_Command_2 = Database.Command.SQLite_Command(file_path, boolean_2, watch_8)

# group: Test: write command to text file
code_block_3 = CodeBlock { "test.txt"; }
writeText = File.WriteText(code_block_3)  # unwired: arg1

# group: B) Set the database filename
string = StringInput("Architectural")

# group: Creates database path relative to RVT
current = Document.Current()
filePath = Document.FilePath(current)
python_get_document_directory = Python(IN[0]=filePath)
# ---------- python_get_document_directory.python (18 lines) ----------
import clr
clr.AddReference('ProtoGeometry')
from Autodesk.DesignScript.Geometry import *

import sys
sys.path.append(r'C:\Program Files (x86)\IronPython 2.7\DLLs')
sys.path.append(r'C:\Program Files (x86)\IronPython 2.7\Lib')

import os

#The inputs to this node will be stored as a list in the IN variables.
filePath = IN[0]

fileFolder = os.path.dirname(filePath)
fileFolder += "\\"

#Assign your output to the OUT variable.
OUT = fileFolder
# ----------------------------------------
string_2 = StringInput(".db")
concat = String.Concat(python_get_document_directory, string, string_2)
