# Dynamo graph GetData.dyn (Dynamo 1.3.1.1736)

# group: Set Category
categories = Categories("DuctCurves")

# group: Get all elements and their parameters
all_elements_of_category = ElementsOfCategory(categories)
parameters = Element.Parameters(all_elements_of_category)
watch = Watch(parameters)

# group: Get parameter values
value = Parameter.Value(parameters)
watch_2 = Watch(value)
string_from_object = FromObject(watch_2)
string = StringInput("ø")
string_2 = StringInput("Diameter")
list_of_lists_of_lists_of_values = String.Replace(str=string_from_object, searchFor=string, replaceWith=string_2)
watch_3 = Watch(list_of_lists_of_lists_of_values)

# group: Get parameter names
name = Parameter.Name(parameters)
watch_4 = Watch(name)

# group: Get one element's parameters and values.
py_create_dictionary = Python(IN[0]=watch_3, IN[1]=watch_4)
# ---------- py_create_dictionary.python (15 lines) ----------
import clr
clr.AddReference('ProtoGeometry')
from Autodesk.DesignScript.Geometry import *
#The inputs to this node will be stored as a list in the IN variables.

values = IN[0]
keys = IN[1]

#myDic = [dict(zip(keys[0], values[0])) for i in keys[0]]

myDic = dict(zip(keys[0],values[0]))

#Assign your output to the OUT variable.
#OUT = myDic["Width"]
OUT = myDic.items()
# ----------------------------------------
watch_5 = Watch(py_create_dictionary)

file_path = Filename("..\..\..\..\RvtSql\Sandbox\Revit Data to SQLite\DB\Mechanical.db")
boolean = BoolSelector(true)
SQLite_Command = Database.Command.SQLite_Command(file_path, boolean)  # unwired: arg2

# group: Get one element parameters and values.
python_script = Python(IN[0]=watch)
# ---------- python_script.python (13 lines) ----------
import clr
clr.AddReference('ProtoGeometry')
from Autodesk.DesignScript.Geometry import *
#The inputs to this node will be stored as a list in the IN variables.
input = IN[0]

# Get all elements' parameters

# Get one element's parameters
myDic = dict(str(e).split(' : ') for e in input[0])

#Assign your output to the OUT variable.
OUT = myDic.items()
# ----------------------------------------
watch_6 = Watch(python_script)

code_block = CodeBlock { "temp.xlsx"; "Sheet1"; 0; 0; }
boolean_2 = BoolSelector(true)
writeToFile = Excel.WriteToFile(filePath=code_block.out0, sheetName=code_block.out1, startRow=code_block.out2, startCol=code_block.out3, data=py_create_dictionary, overWrite=boolean_2)
string_from_object_2 = FromObject(categories)
python_script_2 = Python(IN[0]=string_from_object_2, IN[1]=watch_4, IN[2]=watch_3)
# ---------- python_script_2.python (26 lines) ----------
import clr
clr.AddReference('ProtoGeometry')
from Autodesk.DesignScript.Geometry import *

tableName = IN[0]
listOfFields = IN[1]
listOfValues = IN[2]

# Does this help? Create dictionary items with first value as key
# dictionary = {e[0] : e[0:] for e in listOfValues}
# dicString = ", ".join(listOfValues[0])

# Create SQL command
# TODO: Loop through listOfFields and insert as table fields
# TODO: Loop through listOfValues and insert as table values
sqlCommand = "DROP TABLE IF EXIST " + tableName + "; \n"
sqlCommand += "CREATE TABLE " + tableName + " (ElementId INTEGER, Height REAL, Width REAL, Diameter REAL, Length REAL, CONSTRAINT ElementPk PRIMARY KEY (ElementId));\n" + "BEGIN TRANSACTION; \n"

for item in enumerate(listOfValues):
    sqlCommand+=str("INSERT INTO " + tableName +
              "(ElementId, Height, Width, Diameter, Length) " +
              "VALUES (" + "".join(str(item[1]).translate(None, "[]")) + ");\n")
sqlCommand+="COMMIT;"

# Output for SQLite command node
OUT = sqlCommand
# ----------------------------------------
watch_7 = Watch(python_script_2)
