# Dynamo graph Insert Values.dyn (Dynamo 1.3.1.1736)

# group: Set Category
categories = Categories("DuctCurves")

# group: Get all elements and their parameters
all_elements_of_category = ElementsOfCategory(categories)
parameters = Element.Parameters(all_elements_of_category)

# group: Insert Element Id's to beginning of lists
id = Element.Id(all_elements_of_category)
python_script = Python(IN[0]=id)
# ---------- python_script.python (11 lines) ----------
import clr
clr.AddReference('ProtoGeometry')
from Autodesk.DesignScript.Geometry import *
#The inputs to this node will be stored as a list in the IN variables.
listIn = IN[0]

for index, i in enumerate(listIn):
	listIn[index] = "Element Id : " + str(i)

#Assign your output to the OUT variable.
OUT = listIn
# ----------------------------------------
python_script_2 = Python(IN[0]=parameters, IN[1]=python_script)
# ---------- python_script_2.python (12 lines) ----------
import clr
clr.AddReference('ProtoGeometry')
from Autodesk.DesignScript.Geometry import *
#The inputs to this node will be stored as a list in the IN variables.
mainList = IN[0]
elementIds = IN[1]

for ele_a, ele_b in zip(mainList, elementIds):
    ele_a.insert(0, ele_b)

#Assign your output to the OUT variable.
OUT = mainList
# ----------------------------------------
watch = Watch(python_script_2)

# group: Get all elements and their parameters
all_elements_of_category_2 = ElementsOfCategory(categories)
parameters_2 = Element.Parameters(all_elements_of_category_2)
watch_2 = Watch(parameters_2)

# group: Get parameter names (keys)
name = Parameter.Name(watch_2)
watch_3 = Watch(name)

# group: Get parameter values (values)
getParameterValueByName = Element.GetParameterValueByName(element=all_elements_of_category, parameterName=watch_3)
watch_4 = Watch(getParameterValueByName)

# group: Test: write to excel
code_block = CodeBlock { "temp.xlsx"; "Sheet1"; 0; 0; true; }
writeToFile = Excel.WriteToFile(filePath=code_block.out0, sheetName=code_block.out1, startRow=code_block.out2, startCol=code_block.out3, overWrite=code_block.out4)  # unwired: data

# group: Create list of Element Ids with sublists of parameters
python_create_sublists = Python(IN[2]=python_script_2)  # unwired: IN[0], IN[1]
# ---------- python_create_sublists.python (14 lines) ----------
import clr
clr.AddReference('ProtoGeometry')
from Autodesk.DesignScript.Geometry import *
#The inputs to this node will be stored as a list in the IN variables.
#The inputs to this node will be stored as a list in the IN variables.
tableName = IN[0]
listOfFields = IN[1]
listOfValues = IN[2]

# Create dictionary items with first value as key
dictionary = {e[0].split(" : ")[1] : e[1:] for e in listOfValues}

#Assign your output to the OUT variable.
OUT = dictionary.items()
# ----------------------------------------
watch_5 = Watch(python_create_sublists)

# group: Create CSV of all parameters (all elements)
python_create_dictionary = Python(IN[0]=watch_5)
# ---------- python_create_dictionary.python (27 lines) ----------
import clr
clr.AddReference('ProtoGeometry')
from Autodesk.DesignScript.Geometry import *
#The inputs to this node will be stored as a list in the IN variables.
listIn = IN[0]

oneElement = listIn[0]
oneElementId = oneElement[0]
oneElementsParams = oneElement[1]

allElements = []
allElementParamers = []
csvOutput = ""

for index, i in enumerate(listIn):
	allElements.append(str(listIn[index][0]) + ", " + ','.join(map(str, listIn[index][1])))

for index, i in enumerate(listIn):
	csvOutput += allElements[index] + "\n"

#Create dictionary of parameters with key from param name
#myDic = dict(str(item).split(" : ") for item in oneElementsParams)

# Add Element Id to dictionary
#myDic['Element Id'] = oneElementId

OUT = csvOutput
# ----------------------------------------
watch_6 = Watch(python_create_dictionary)

file_path = Filename("..\DB\Mechanical.db")
boolean = BoolSelector(false)

# group: Create dictionary of parameters (one element)
python_create_dictionary_2 = Python(IN[0]=watch_5)
# ---------- python_create_dictionary_2.python (33 lines) ----------
import clr
clr.AddReference('ProtoGeometry')
from Autodesk.DesignScript.Geometry import *
#The inputs to this node will be stored as a list in the IN variables.
listIn = IN[0]

oneElement = listIn[0]
oneElementId = oneElement[0]
oneElementsParams = oneElement[1]

#Create dictionary of parameters with key from param name
myDic = dict(str(item).split(" : ") for item in oneElementsParams)

# Add Element Id to dictionary
myDic['Element Id'] = oneElementId

OUT = myDic.items()

# Output dictionary with Element Id as key
#elementDict = dict(zip(listIn[0][0:][0],listIn[0][0:][1]))
#OUT = elementDict.items()

# First element
#OUT = listIn[0][0]

# Drill down to first element Id
#OUT = listIn[0][0][0]

# Drill down to first list of parameters 
#OUT = listIn[0][0][1]

# Drill down to first parameter in first list of parameters
#OUT = listIn[0][1][0]
# ----------------------------------------
watch_7 = Watch(python_create_dictionary_2)

python_string_from_object = Python(IN[0]=categories)
# ---------- python_string_from_object.python (9 lines) ----------
import clr
clr.AddReference('ProtoGeometry')
from Autodesk.DesignScript.Geometry import *
#The inputs to this node will be stored as a list in the IN variables.
category = IN[0]


#Assign your output to the OUT variable.
OUT = '"' + str(category) + '"'
# ----------------------------------------
code_block_2 = CodeBlock(tableName=python_string_from_object) { tableName; }

# group: Create SQL command (one element)
python_sql_command = Python(IN[0]=watch_7, IN[1]=code_block_2)
# ---------- python_sql_command.python (41 lines) ----------
import clr
clr.AddReference('ProtoGeometry')
from Autodesk.DesignScript.Geometry import *
#The inputs to this node will be stored as a list in the IN variables.
listIn = IN[0]
tableName = IN[1]

sqlCommand = ""
questionMarks = "" 
columnNames = ""
columnValues = ""


for listIndex, i in enumerate(listIn):
	columnNames += '"' + listIn[listIndex][0] + '"' + ', '
columnNames = columnNames[:-2]
	
for listIndex, i in enumerate(listIn):
	# Catch and replace certain characters that break the string
	listIn[listIndex][1] = listIn[listIndex][1].replace("\"", " in")
	listIn[listIndex][1] = listIn[listIndex][1].replace("\'", " ft")
	listIn[listIndex][1] = listIn[listIndex][1].replace("ø", " Diam")
	
	# Write to columnValues with values wrapped in quptes and separated by commas
	columnValues += '"' + listIn[listIndex][1] + '"' + ', '
columnValues = columnValues[:-2]

for listIndex, i in enumerate(listIn):
	questionMarks += '?, '
questionMarks = questionMarks[:-2]

# Create a table in the db
#sqlCommand += "CREATE TABLE " + tableName + " (" + columnNames + ") \n"

sqlCommand += "INSERT INTO " + tableName
sqlCommand += " (" + columnNames + ") \n"
#sqlCommand += "VALUES (" + questionMarks + "), " + columnValues
sqlCommand += "VALUES (" + columnValues + ")"

#Assign your output to the OUT variable.
OUT = sqlCommand
# ----------------------------------------
watch_8 = Watch(python_sql_command)

SQLite_Command = Database.Command.SQLite_Command(file_path, boolean, watch_8)

# group: Test: write to CSV
code_block_3 = CodeBlock { "temp.csv"; }
writeToFile_2 = CSV.WriteToFile(code_block_3)  # unwired: arg1

# group: Create SQL command for all elements
python_create_dictionary_3 = Python(IN[0]=watch_5, IN[1]=code_block_2)
# ---------- python_create_dictionary_3.python (33 lines) ----------
import clr
clr.AddReference('ProtoGeometry')
from Autodesk.DesignScript.Geometry import *
#The inputs to this node will be stored as a list in the IN variables.
tableName = IN[1]
listIn = IN[0]

sqlCommand = ""
columnNames = ""

oneElement = listIn[0]
oneElementId = oneElement[0]
oneElementsParams = oneElement[1]

allElements = []
allElementParamers = []

for listIndex, i in enumerate(listIn):
	for pIndex, param in enumerate(listIn[listIndex]):
		columnNames += '"' + str(listIn[listIndex][1][pIndex]) + '"' + ', '
#columnNames = columnNames[:-2]

for index, i in enumerate(listIn):
	allElements.append(str(listIn[index][0]) + ", " + ','.join(map(str, listIn[index][1])))

#for index, i in enumerate(listIn):
#	sqlCommand += allElements[index] + "\n"

# Create SQL command
for i in listIn:
	sqlCommand += "INSERT INTO " + tableName + " (" + "XXX" + ") \n"

OUT = listIn
# ----------------------------------------
watch_9 = Watch(python_create_dictionary_3)

# group: Create dictionary of parameters (one element)
python_create_dictionary_4 = Python(IN[0]=watch_5)
# ---------- python_create_dictionary_4.python (43 lines) ----------
import clr
clr.AddReference('ProtoGeometry')
from Autodesk.DesignScript.Geometry import *
#The inputs to this node will be stored as a list in the IN variables.
listIn = IN[0]

oneElement = listIn[0]
oneElementId = oneElement[0]
oneElementsParams = oneElement[1]

allElements = []

for index, i in enumerate(listIn):
	allElements.append(["Element Id : " + listIn[index][0]])
	
for index, i in enumerate(listIn):
	for pIndex, p in enumerate(listIn[index]):
		allElements.append(listIn[index][pIndex])
	

#Create dictionary of parameters with key from param name
#myDic = dict(str(item).split(" : ") for item in oneElementsParams)

# Add Element Id to dictionary
#myDic['Element Id'] = oneElementId

OUT = allElements

# Output dictionary with Element Id as key
#elementDict = dict(zip(listIn[0][0:][0],listIn[0][0:][1]))
#OUT = elementDict.items()

# First element
#OUT = listIn[0][0]

# Drill down to first element Id
#OUT = listIn[0][0][0]

# Drill down to first list of parameters 
#OUT = listIn[0][0][1]

# Drill down to first parameter in first list of parameters
#OUT = listIn[0][1][0]
# ----------------------------------------
watch_10 = Watch(python_create_dictionary_4)
