# Dynamo graph CompareSqliteTables-0.0.1.dyn (Dynamo 1.3.0.875)

file_path = Filename("..\DB\Mechanical.db")
boolean = BoolSelector(true)
SQLite_Query = Database.Query.SQLite_Query(file_path, boolean)  # unwired: arg2

# group: Get list of tables from db
py_get_list_of_tables = Python(IN[0]=file_path)
# ---------- py_get_list_of_tables.python (25 lines) ----------
import clr
clr.AddReference('ProtoGeometry')
from Autodesk.DesignScript.Geometry import *

import sys
sys.path.append(r'C:\Program Files (x86)\IronPython 2.7\DLLs')
sys.path.append(r'C:\Program Files (x86)\IronPython 2.7\Lib')
import sqlite3
import xml

#The inputs to this node will be stored as a list in the IN variables.
database = IN[0]

conn = sqlite3.connect(database)
conn_cursor = conn.cursor()
conn.text_factory = str

res = conn.execute("SELECT name FROM sqlite_master WHERE type='table';")
tables = []

for name in res:
   tables.append(name[0])

#Assign your output to the OUT variable.
OUT = tables
# ----------------------------------------
listOfTables = Watch(py_get_list_of_tables)

count = Count(listOfTables)

# group: Get current and previous db tableNames
code_block = CodeBlock(total=count) { total-2; }
getItemAtIndex = List.GetItemAtIndex(list=listOfTables, index=code_block)
code_block_2 = CodeBlock(total=count) { total-1; }
getItemAtIndex_2 = List.GetItemAtIndex(list=listOfTables, index=code_block_2)
