# Dynamo graph CompareSqliteTables-0.0.2.dyn (Dynamo 1.3.0.875)

file_path = Filename("..\DB\Mechanical.db")
boolean = BoolSelector(true)
SQLite_Query = Database.Query.SQLite_Query(file_path, boolean)  # unwired: arg2

# group: Get list of tables from db
py_get_list_of_tables = Python(IN[0]=file_path)
# ---------- py_get_list_of_tables.python (25 lines) ----------
import clr
clr.AddReference('ProtoGeometry')
from Autodesk.DesignScript.Geometry import *

import sys
sys.path.append(r'C:\Program Files (x86)\IronPython 2.7\DLLs')
sys.path.append(r'C:\Program Files (x86)\IronPython 2.7\Lib')
import sqlite3
import xml

#The inputs to this node will be stored as a list in the IN variables.
database = IN[0]

conn = sqlite3.connect(database)
conn_cursor = conn.cursor()
conn.text_factory = str

res = conn.execute("SELECT name FROM sqlite_master WHERE type='table';")
tables = []

for name in res:
   tables.append(name[0])

#Assign your output to the OUT variable.
OUT = tables
# ----------------------------------------
listOfTables = Watch(py_get_list_of_tables)

count = Count(listOfTables)

# group: Get current and previous db tableNames
code_block = CodeBlock(total=count) { total-2; }
previousTableName = List.GetItemAtIndex(list=listOfTables, index=code_block)
code_block_2 = CodeBlock(total=count) { total-1; }
currentTableName = List.GetItemAtIndex(list=listOfTables, index=code_block_2)

py_get_rows_a_list_items = Python(IN[0]=file_path, IN[1]=previousTableName)
# ---------- py_get_rows_a_list_items.python (26 lines) ----------
import clr
clr.AddReference('ProtoGeometry')
from Autodesk.DesignScript.Geometry import *

import sys
sys.path.append(r'C:\Program Files (x86)\IronPython 2.7\DLLs')
sys.path.append(r'C:\Program Files (x86)\IronPython 2.7\Lib')
import sqlite3
import xml

#The inputs to this node will be stored as a list in the IN variables.
database = IN[0]
tableName = IN[1]

conn = sqlite3.connect(database)
cur = conn.cursor()
conn.text_factory = str

query = "SELECT * FROM " + tableName

cur.execute(query)

rows = list(cur.fetchall())

#Assign your output to the OUT variable.
OUT = rows
# ----------------------------------------
watch = Watch(py_get_rows_a_list_items)
py_get_rows_a_list_items_2 = Python(IN[0]=file_path, IN[1]=currentTableName)  # same code as py_get_rows_a_list_items
watch_2 = Watch(py_get_rows_a_list_items_2)
python_script = Python(IN[0]=py_get_rows_a_list_items, IN[1]=py_get_rows_a_list_items_2)
# ---------- python_script.python (13 lines) ----------
import clr
clr.AddReference('ProtoGeometry')
from Autodesk.DesignScript.Geometry import *
#The inputs to this node will be stored as a list in the IN variables.
previousList = IN[0]
currentList = IN[1]

diff = [[x for x in previousList if x not in currentList], [x for x in currentList if x not in previousList]]



#Assign your output to the OUT variable.
OUT = diff
# ----------------------------------------
watch_3 = Watch(python_script)
python_script_2 = Python(IN[0]=watch_3)
# ---------- python_script_2.python (13 lines) ----------
import clr
clr.AddReference('ProtoGeometry')
from Autodesk.DesignScript.Geometry import *
#The inputs to this node will be stored as a list in the IN variables.
listOfChanges = IN[0]

string = ""

for i in listOfChanges:
	string += str(i)

#Assign your output to the OUT variable.
OUT = string
# ----------------------------------------
watch_4 = Watch(python_script_2)
ownerView = Custom[Element.OwnerView]()  # Gets the owner view of a given Revit element (if possible); unwired: element

# group: Create View
string = StringInput("ChangeLog - ")
string_from_object = FromObject(previousTableName)
string_2 = StringInput(" x ")
string_from_object_2 = FromObject(currentTableName)
concat = String.Concat(string, string_from_object, string_2, string_from_object_2)
byName = DraftingView.ByName(concat)

code_block_3 = CodeBlock { 0; 0; 0; }
byCoordinates = Point.ByCoordinates(x=code_block_3.out0, y=code_block_3.out1, z=code_block_3.out2)
code_block_4 = CodeBlock { "Left"; }
byLocation = TextNote.ByLocation(view=byName, location=byCoordinates, text=python_script_2, alignment=code_block_4)
id = Element.Id(byLocation)
byElementId = Archilab.Grimshaw.Selection.Select.ByElementId(id)
end = Revit.Transaction.Transaction.End(byName)
byElement = Custom[BoundingBox.ByElement](element=byElementId, view=end)  # Gets the bounding box of a Revit element
X = ReferencePoint.X(byElement.BottomLeftRearCorner)
Y = ReferencePoint.Y(byElement.BottomLeftRearCorner)
code_block_5 = CodeBlock(y=Y) { 0; -(y*5); 0; }
byCoordinates_2 = Point.ByCoordinates(x=code_block_5.out0, y=code_block_5.out1, z=code_block_5.out2)
code_block_6 = CodeBlock { "Test"; }
byLocation_2 = TextNote.ByLocation(view=end, location=byCoordinates_2, text=code_block_6, alignment=code_block_4)
id_2 = Element.Id(byLocation_2)
byElementId_2 = Archilab.Grimshaw.Selection.Select.ByElementId(id_2)
passthrough = Custom[Passthrough]()  # Forces a sequential order of execution. The node wired into the output of the Passthrough node will be executed *after* the node wired into the waitFor input (e.g. important for some Revit operations). The value of the passThrough input will be passed on to the node wired into the output port of the Passthrough node.; unwired: passThrough, waitFor
passthrough_2 = Custom[Passthrough]()  # unwired: passThrough, waitFor
