# Dynamo graph InsertIntoSqlite-0.1.0.dyn (Dynamo 1.3.0.875)

categories = Categories("DuctCurves")
all_elements_of_category = ElementsOfCategory(categories)
parameters = Element.Parameters(all_elements_of_category)
watch = Watch(parameters)
value = Parameter.Value(parameters)
watch_2 = Watch(value)
string_from_object = FromObject(watch_2)
string = StringInput("ø")
string_2 = StringInput("Diameter")
list_of_lists_of_lists_of_values = String.Replace(str=string_from_object, searchFor=string, replaceWith=string_2)
watch_3 = Watch(list_of_lists_of_lists_of_values)
name = Parameter.Name(parameters)
watch_4 = Watch(name)
python_script = Python(IN[0]=watch_4, IN[1]=list_of_lists_of_lists_of_values)
# ---------- python_script.python (11 lines) ----------
import clr
clr.AddReference('ProtoGeometry')
from Autodesk.DesignScript.Geometry import *
#The inputs to this node will be stored as a list in the IN variables.
keys = IN[0]
values = IN[1]

myDic = dict(zip(keys[0],values[0]))

#Assign your output to the OUT variable.
OUT = myDic["System Type"]
# ----------------------------------------
watch_5 = Watch(python_script)
code_block = CodeBlock(x=watch_2) { x[0][1]; }
name_2 = Element.Name(code_block)
