# Dynamo graph InsertIntoSqlite.dyn (Dynamo 1.3.0.875)

categories = Categories("DuctCurves")
all_elements_of_category = ElementsOfCategory(categories)

# group: Get element parameters
id = Element.Id(all_elements_of_category)
string_from_object = FromObject(id)
code_block = CodeBlock { "Height"; "Width"; "Diameter"; "Length"; }
getParameterValueByName = Element.GetParameterValueByName(element=all_elements_of_category, parameterName=code_block.out0)
string_from_object_2 = FromObject(getParameterValueByName)
getParameterValueByName_2 = Element.GetParameterValueByName(element=all_elements_of_category, parameterName=code_block.out1)
string_from_object_3 = FromObject(getParameterValueByName_2)
getParameterValueByName_3 = Element.GetParameterValueByName(element=all_elements_of_category, parameterName=code_block.out2)
string_from_object_4 = FromObject(getParameterValueByName_3)
getParameterValueByName_4 = Element.GetParameterValueByName(element=all_elements_of_category, parameterName=code_block.out3)
string_from_object_5 = FromObject(getParameterValueByName_4)

total_elements = List.Count(all_elements_of_category)

# group: Get list of [element id, parameter, ...]
join = List.Join(string_from_object, string_from_object_2, string_from_object_3, string_from_object_4, string_from_object_5)
chop = List.Chop(list=join, lengths=total_elements)
code_block_2 = CodeBlock(list=chop) { list[0]; list[1]; list[2]; list[3]; list[4]; }
py_zips_lists = Python(IN[0]=code_block_2.out0, IN[1]=code_block_2.out1, IN[2]=code_block_2.out2, IN[3]=code_block_2.out3, IN[4]=code_block_2.out4)
# ---------- py_zips_lists.python (12 lines) ----------
import clr
clr.AddReference('ProtoGeometry')
from Autodesk.DesignScript.Geometry import *
#The inputs to this node will be stored as a list in the IN variables.
elementIds = IN[0]
Heights = IN[1]
Widths = IN[2]
Diameters = IN[3]
Lengths = IN[4]

#Assign your output to the OUT variable.
OUT = zip(elementIds, Heights, Widths, Diameters, Lengths)
# ----------------------------------------
watch = Watch(py_zips_lists)
watch_2 = Watch(chop)

# group: Create tableName as <Category>_<datetime.utcnow>
string_from_object_6 = FromObject(categories)
string = StringInput("_")
now = DateTime.Now()
string_from_object_7 = FromObject(now)
py_create_unix_timestamp = Python(IN[0]=string_from_object_7)
# ---------- py_create_unix_timestamp.python (10 lines) ----------
import sys
sys.path.append(r"C:\Program Files (x86)\IronPython 2.7\Lib")
from datetime import datetime
import time
import calendar

now = datetime.utcnow()
str_format = IN[0]

OUT = calendar.timegm(now.utctimetuple())
# ----------------------------------------
string_from_object_8 = FromObject(py_create_unix_timestamp)
concat = String.Concat(string_from_object_6, string, string_from_object_8)
watch_3 = Watch(py_create_unix_timestamp)
tableName = Watch(concat)

# group: Set to True to write to db
py_generate_sql_command = Python(IN[0]=concat, IN[2]=py_zips_lists)  # unwired: IN[1]
# ---------- py_generate_sql_command.python (28 lines) ----------
import clr
clr.AddReference('ProtoGeometry')
from Autodesk.DesignScript.Geometry import *
#The inputs to this node will be stored as a list in the IN variables.
tableName = IN[0]
listOfFields = IN[1]
listOfValues = IN[2]

#listOfValues = [["9999", "1", "3", "5", "7", "9", "11"], ["8888", "2", "4", "6", "8", "10", "12"]]
#tableName = "MechDucts"

# Create dictionary items with first value as key
dictionary = {e[0] : e[0:] for e in listOfValues}

dicString = ", ".join(listOfValues[0])

# Create SQL command
sqlCommand = ""
sqlCommand += "CREATE TABLE " + tableName + " (ElementId INTEGER, Height REAL, Width REAL, Diameter REAL, Length REAL, CONSTRAINT ElementPk PRIMARY KEY (ElementId));\n" + "BEGIN TRANSACTION; \n"

for item in enumerate(listOfValues):
    sqlCommand+=str("INSERT INTO " + tableName +
              "(ElementId, Height, Width, Diameter, Length) " +
              "VALUES (" + "".join(str(item[1]).translate(None, "[]")) + ");\n")
sqlCommand+="COMMIT;"

#Assign your output to the OUT variable.
OUT = sqlCommand
# ----------------------------------------
watch_4 = Watch(py_generate_sql_command)
file_path = Filename("..\..\..\..\..\..\Dev Lab\SeaDUG\Sandbox\SQLite Example\DB\Mechanical.db")
boolean = BoolSelector(false)
SQLite_Command = Database.Command.SQLite_Command(file_path, boolean, py_generate_sql_command)

# group: Get Element Id as list to insert
id_2 = Element.Id(all_elements_of_category)
watch_5 = Watch(id_2)
code_block_3 = CodeBlock(x=id_2) { "Element Id : " + x; }
watch_6 = Watch(code_block_3)

# group: Get all parameters
parameters = Element.Parameters(all_elements_of_category)
watch_7 = Watch(parameters)

string_from_object_9 = FromObject(watch_7)

# group: Add Element Ids to beginning of list
python_script = Python(IN[0]=string_from_object_9, IN[1]=code_block_3)
# ---------- python_script.python (15 lines) ----------
import clr
clr.AddReference('ProtoGeometry')
from Autodesk.DesignScript.Geometry import *
#The inputs to this node will be stored as a list in the IN variables.
elements = IN[0]
elementIds = IN[1]

for index, i in enumerate(elementIds):
	elements[index].insert(0, elementIds[index])
	
#for index, i in enumerate(elementIds):
#	elements[index].append(elementIds[index])

#Assign your output to the OUT variable.
OUT = elements
# ----------------------------------------
watch_8 = Watch(python_script)

# group: Get keys
code_block_4 = CodeBlock { " : "; }
indexOf = String.IndexOf(string=python_script, searchFor=code_block_4)
length = String.Length(python_script)
remove_characters_after_key = CodeBlock(length=length, split=indexOf) { length-split; }
remove = String.Remove(str=python_script, startIndex=indexOf, count=remove_characters_after_key)
watch_9 = Watch(remove)

# group: Get values
code_block_5 = CodeBlock { 0; }
code_block_6 = CodeBlock { " : "; }
indexOf_2 = String.IndexOf(string=python_script, searchFor=code_block_6)
code_block_7 = CodeBlock(index=indexOf_2) { index+3; }
remove_2 = String.Remove(str=python_script, startIndex=code_block_5, count=code_block_7)
watch_10 = Watch(remove_2)

# group: Replace 'ø' with "Diameter" (for lack of better method of storing unicode char)
string_2 = StringInput("ø")
string_3 = StringInput(" Diameter")
replace = String.Replace(str=remove_2, searchFor=string_2, replaceWith=string_3)
watch_11 = Watch(replace)

# group: Get value from key and item at index
key_name = CodeBlock { "Size"; }
item_index = CodeBlock { 1; }
py_get_value_from_key = Python(IN[0]=remove, IN[1]=replace, IN[2]=key_name, IN[3]=item_index)
# ---------- py_get_value_from_key.python (35 lines) ----------
import clr
clr.AddReference('ProtoGeometry')
from Autodesk.DesignScript.Geometry import *
import sys
sys.path.append(r'C:\Program Files (x86)\IronPython 2.7\DLLs')
sys.path.append(r'C:\Program Files (x86)\IronPython 2.7\Lib')
import itertools

#The inputs to this node will be stored as a list in the IN variables.
keys = IN[0]
values = IN[1]
keyName = IN[2]
indexNumber = IN[3]

keysTuple = tuple(keys)
valuesTuple = tuple(values)

testKeys = []
testValues = []

listOfDics = [{}]

for k in keys[indexNumber]:
	testKeys.append(str(k))
for v in values[indexNumber]:
	testValues.append(str(v))
	
myDic = dict(zip(testKeys,testValues))

listOfDics.append(myDic.copy())

#OUT = testString
OUT = myDic[keyName]
#OUT = str(myDic)
#OUT = str(testKeys)
# ----------------------------------------

# group: Create dictionary w/ Element Id as key
py_create_dictionary = Python(IN[0]=remove, IN[1]=replace, IN[2]=python_script)
# ---------- py_create_dictionary.python (33 lines) ----------
import clr
clr.AddReference('ProtoGeometry')
from Autodesk.DesignScript.Geometry import *

import sys
sys.path.append(r'C:\Program Files (x86)\IronPython 2.7\DLLs')
sys.path.append(r'C:\Program Files (x86)\IronPython 2.7\Lib')

import itertools

#The inputs to this node will be stored as a list in the IN variables.
keys = IN[0]
values = IN[1]
keysAndValues = IN[2]

#myDic = {t[0]:t[1:] for t in all}
myDic = []

#for list in keysAndValues:
#	for parameter in list:
#		myDic.append({parameter[4 - parameter.find(" : "):]:list})
		
for list in keysAndValues:
	myDic.append({list[0][4 - list[0].find(" : "):]:list[1:]})

oneElementDic = dict(zip(keys[0], values[0]))

#Assign your output to the OUT variable.
#OUT = keysAndValues[0]
#OUT = oneElementDic['Element Id']
OUT = str(myDic)
#OUT = all[0][0]
#OUT = str(myDic)
# ----------------------------------------
watch_12 = Watch(py_create_dictionary)

file_path_2 = Filename("..\DB\Mechanical.db")

# group: Create tableName as <Category>_<datetime.utcnow>
string_from_object_10 = FromObject(categories)
string_4 = StringInput("_")
now_2 = DateTime.Now()
string_from_object_11 = FromObject(now_2)
py_create_unix_timestamp_2 = Python(IN[0]=string_from_object_11)  # same code as py_create_unix_timestamp
string_from_object_12 = FromObject(py_create_unix_timestamp_2)
concat_2 = String.Concat(string_from_object_10, string_4, string_from_object_12)
tableName_2 = Watch(concat_2)
watch_13 = Watch(py_create_unix_timestamp_2)

# group: Get all unique parameter names
flatten = Flatten(remove)
uniqueItems = List.UniqueItems(flatten)

# group: Format parameter names for use as column names in SQL command
string_5 = StringInput("CONSTRAINT ElementId_pk PRIMARY KEY (\"Element Id\")")
py_add_datatype_to_params = Python(IN[0]=uniqueItems)
# ---------- py_add_datatype_to_params.python (12 lines) ----------
import clr
clr.AddReference('ProtoGeometry')
from Autodesk.DesignScript.Geometry import *
#The inputs to this node will be stored as a list in the IN variables.
parameters = IN[0]

dataType = "TEXT"

paramsWithTypes = ['"' + i + '" ' + dataType for i in parameters]

#Assign your output to the OUT variable.
OUT = paramsWithTypes
# ----------------------------------------
addItemToEnd = List.AddItemToEnd(item=string_5, list=py_add_datatype_to_params)
string_6 = StringInput("\"Element Id\" TEXT")
string_7 = StringInput("\"Element Id\" INTEGER")
replace_2 = String.Replace(str=addItemToEnd, searchFor=string_6, replaceWith=string_7)

# group: Removes "{ ,}" from string
string_from_array = FromArray(replace_2)
code_block_8 = CodeBlock { 0; 1; }
remove_3 = String.Remove(str=string_from_array, startIndex=code_block_8.out0, count=code_block_8.out1)
length_2 = String.Length(remove_3)
code_block_9 = CodeBlock(length=length_2) { length - 1; }
code_block_10 = CodeBlock { 1; }
remove_4 = String.Remove(str=remove_3, startIndex=code_block_9, count=code_block_10)

# group: Create table in SQLite db
boolean_2 = BoolSelector(true)
string_8 = StringInput(";")
code_block_11 = CodeBlock(tableName=tableName_2, stringOfKeys=remove_4, endCommand=string_8) { "CREATE TABLE " + tableName + "(" + stringOfKeys + ")" + endCommand; }
SQLite_Command_2 = Database.Command.SQLite_Command(file_path_2, boolean_2, code_block_11)
code_block_12 = CodeBlock { "Test.txt"; }
writeText = File.WriteText(code_block_12, code_block_11)

boolean_3 = BoolSelector(true)
py_add_quotes_to_params = Python(IN[0]=uniqueItems)
# ---------- py_add_quotes_to_params.python (12 lines) ----------
import clr
clr.AddReference('ProtoGeometry')
from Autodesk.DesignScript.Geometry import *
#The inputs to this node will be stored as a list in the IN variables.
parameters = IN[0]

dataType = "TEXT"

paramsWithQuotes = ['"' + i + '"' for i in parameters]

#Assign your output to the OUT variable.
OUT = paramsWithQuotes
# ----------------------------------------
python_script_2 = Python(IN[0]=py_add_quotes_to_params)
# ---------- python_script_2.python (10 lines) ----------
import clr
clr.AddReference('ProtoGeometry')
from Autodesk.DesignScript.Geometry import *
#The inputs to this node will be stored as a list in the IN variables.
listOfCols = IN[0]

listOfVals = [':' + i for i in listOfCols]

#Assign your output to the OUT variable.
OUT = listOfVals
# ----------------------------------------

# group: Removes "{ ,}" from string
string_from_array_2 = FromArray(python_script_2)
code_block_13 = CodeBlock { 0; 1; }
remove_5 = String.Remove(str=string_from_array_2, startIndex=code_block_13.out0, count=code_block_13.out1)
length_3 = String.Length(remove_5)
code_block_14 = CodeBlock(length=length_3) { length - 1; }
code_block_15 = CodeBlock { 1; }
remove_6 = String.Remove(str=remove_5, startIndex=code_block_14, count=code_block_15)

string_9 = StringInput(";")
code_block_16 = CodeBlock(tableName=tableName_2, listofValues=remove_6, endCommand=string_9) { "INSERT INTO " + tableName + " VALUES (" + listofValues + ")" + endCommand; }
SQLite_Command_3 = Database.Command.SQLite_Command(file_path_2, boolean_3, code_block_16)

# group: Removes "{ ,}" from string
string_from_array_3 = FromArray(py_add_quotes_to_params)
code_block_17 = CodeBlock { 0; 1; }
remove_7 = String.Remove(str=string_from_array_3, startIndex=code_block_17.out0, count=code_block_17.out1)
length_4 = String.Length(remove_7)
code_block_18 = CodeBlock(length=length_4) { length - 1; }
code_block_19 = CodeBlock { 1; }
remove_8 = String.Remove(str=remove_7, startIndex=code_block_18, count=code_block_19)

code_block_20 = CodeBlock(tableName=tableName_2, listOfKeys=remove_8, listofValues=remove_6, endCommand=string_9) { "INSERT INTO " + tableName + " (" + listOfKeys + ") " + "VALUES (" + listofValues + ")" + endCommand; }
string_10 = StringInput("CONSTRAINT ElementId_pk PRIMARY KEY (\"Element Id\")")
addItemToEnd_2 = List.AddItemToEnd(item=string_10)  # unwired: list
string_11 = StringInput("\"Element Id\" TEXT")
string_12 = StringInput("\"Element Id\" INTEGER")
replace_3 = String.Replace(searchFor=string_11, replaceWith=string_12)  # unwired: str
