# Dynamo graph SelectSqlite.dyn (Dynamo 1.3.0.875)

# group: Get list of tables in db
boolean = BoolSelector(true)
string = StringInput("*")
string_2 = StringInput("sqlite_master")
string_3 = StringInput("type='table'")
selectFromWhere = Database.SQL.SelectFromWhere(string, string_2, string_3)
SQLite_Query = Database.Query.SQLite_Query(arg1=boolean, arg2=selectFromWhere)  # unwired: arg0
watch = Watch(SQLite_Query)
watch_2 = Watch(selectFromWhere)

# group: Get current table
boolean_2 = BoolSelector(true)
string_4 = StringInput("*")
selectFrom = Database.SQL.SelectFrom(string_4)  # unwired: arg1
SQLite_Query_2 = Database.Query.SQLite_Query(arg1=boolean_2, arg2=selectFrom)  # unwired: arg0
watch_3 = Watch(SQLite_Query_2)
