# Dynamo graph GetSpData.dyn (Dynamo 1.3.0.875)

create = List.Create()  # unwired: arg0
file_path = Filename("C:\Users\JRMerlan\Downloads\NBS_BIMObjectStandardParameters_v1_4_1\NBS_BIMObjectStandardParameters_v1_4_1.txt")
readText = File.ReadText(file_path)
watch = Watch(readText)
code_block = CodeBlock { "\n"; }
split = String.Split(watch, code_block)
watch_2 = Watch(split)
python_script = Python(IN[0]=split)
# ---------- python_script.python (10 lines) ----------
import clr
clr.AddReference('ProtoGeometry')
from Autodesk.DesignScript.Geometry import *
#The inputs to this node will be stored as a list in the IN variables.
fullList = IN

del fullList[0]

#Assign your output to the OUT variable.
OUT = fullList
# ----------------------------------------
