# Dynamo graph SheetNumbering.dyn (Dynamo 1.3.0.875)

categories = Categories("Sheets")
all_elements_of_category = ElementsOfCategory(categories)
watch = Watch(all_elements_of_category)
code_block = CodeBlock { "SHEET POSITION"; }
getParameterValueByName = Element.GetParameterValueByName(element=all_elements_of_category, parameterName=code_block)
watch_2 = Watch(getParameterValueByName)
code_block_2 = CodeBlock {  }
indexOf = IndexOf()  # unwired: arg0, arg1
count = Count(getParameterValueByName)
code_block_3 = CodeBlock(X=count) { 1..X; }
watch_3 = Watch(code_block_3)
setParameterByName = Element.SetParameterByName(element=all_elements_of_category, parameterName=code_block, value=watch_3)
